# Grasshopper definition grasshopper-boomerang.gh (Grasshopper 1.0.7)

trailing_edge = Slider(1, range=-1.001..5)
fillet = Slider(4, range=-1.001..5)
thickness = Slider(3, range=1..5)
Z = UnitZ(Factor=1)
main_outline = Curve(<curve referenced from the Rhino model>)
top_outline = Curve(<curve referenced from the Rhino model>)
multiplication = Multiplication(A=trailing_edge, B=Z)
multiplication_2 = Multiplication(A=thickness, B=Z)
loft_opt = LoftOptions(Closed=False, Adjust=False, Rebuild=100, Refit=100, Type=3)
# Grab the two outlines and move the main outline up slightly, and the top outline to the full thickness.
move = Move(Geometry=main_outline, Motion=multiplication)  # -> Geometry, Transform
move_2 = Move(Geometry=top_outline, Motion=multiplication_2)  # -> Geometry, Transform
# Loft over the three curves and cap the ends. This completes the main boomerang shape.
loft = Loft(Curves=[main_outline, move.Geometry, move_2.Geometry], Options=loft_opt)
capex = CapHolesEx(Brep=loft)  # -> Brep, Caps, Solid
debrep = DeconstructBrep(Brep=capex.Brep)  # -> Faces, Edges, Vertices
evalsrf = EvaluateSurface(Surface=debrep.Faces, Point=Point(0, -5, 0))  # -> Point, Normal, UDirection, VDirection, Frame
Z_2 = UnitZ(Factor=1)
dprod = DotProduct(VectorA=evalsrf.Normal, VectorB=Z_2, Unitize=False)
# Figure out which is the top face by comparing its normal to Unit Z. Isolate the edge around the top face.
similar = Similarity(FirstNumber=dprod, SecondNumber=1, Threshold=0.1)  # -> Similarity, AbsoluteDifference
cull = CullPattern(List=evalsrf.Point, CullPattern=similar.Similarity)
edgesfaces = EdgesFromFaces(Brep=capex.Brep, Points=cull)  # -> Edges, Indices
# Fillet the top edge by the desired amount.
boomerang = FilletEdge(Shape=capex.Brep, Blend=0, Metric=0, Edges=edgesfaces.Indices, Radii=fillet)
